# Dynamo graph Mass_Analysis.dyn (Dynamo 2.19.3.6394)

n1_Clean_Mass = Python()  # "1_Clean_Mass"; CPython3; unwired: IN[0]
# ---------- n1_Clean_Mass.python (62 lines) ----------
import clr
clr.AddReference('RevitAPI')
clr.AddReference('RevitServices')
from Autodesk.Revit.DB import *
from RevitServices.Persistence import DocumentManager
from RevitServices.Transactions import TransactionManager

doc = DocumentManager.Instance.CurrentDBDocument
WORKSET_NAME = "Rooms_3D_Visual"

# ── Buscar workset ─────────────────────────────────────────
workset_id = None
workset_int = None
for ws in FilteredWorksetCollector(doc).OfKind(WorksetKind.UserWorkset):
    if ws.Name == WORKSET_NAME:
        workset_id  = ws.Id
        workset_int = ws.Id.IntegerValue
        break

if workset_id is None:
    OUT = ["Workset '{}' no encontrado — nada que limpiar.".format(WORKSET_NAME)]
else:
    # ── Recoger TODAS las masas y filtrar por workset ──────
    all_masses = FilteredElementCollector(doc)\
        .OfCategory(BuiltInCategory.OST_Mass)\
        .WhereElementIsNotElementType()\
        .ToElements()

    # Diagnóstico: ver qué workset tiene cada masa
    debug = []
    to_delete = []

    for m in all_masses:
        ws_param = m.get_Parameter(BuiltInParameter.ELEM_PARTITION_PARAM)
        if ws_param is None:
            debug.append("{} → sin param workset".format(m.Name or "?"))
            continue
        mass_ws_int = ws_param.AsInteger()
        debug.append("{} → workset ID: {} (buscamos: {})".format(
            m.Name or "?", mass_ws_int, workset_int))
        if mass_ws_int == workset_int:
            to_delete.append(m.Id)

    # ── Eliminar ───────────────────────────────────────────
    deleted = 0
    if to_delete:
        TransactionManager.Instance.EnsureInTransaction(doc)
        for eid in to_delete:
            try:
                doc.Delete(eid)
                deleted += 1
            except:
                pass
        TransactionManager.Instance.TransactionTaskDone()

    OUT = [
        "Workset '{}' ID: {}".format(WORKSET_NAME, workset_int),
        "Total masas en modelo: {}".format(len(list(all_masses))),
        "Masas a eliminar: {}".format(len(to_delete)),
        "Eliminadas: {}".format(deleted),
        "Detalle (primeras 10): {}".format(debug[:10])
    ]
# ----------------------------------------
n1_Control_Par = Python(IN[0]=n1_Clean_Mass)  # "1.1_Control_Par"; CPython3
# ---------- n1_Control_Par.python (45 lines) ----------
# Nodo de diagnóstico — conecta su OUT a un Watch
import clr
clr.AddReference('RevitAPI')
clr.AddReference('RevitServices')
from Autodesk.Revit.DB import *
from RevitServices.Persistence import DocumentManager

doc = DocumentManager.Instance.CurrentDBDocument

all_rooms = []

host_rooms = FilteredElementCollector(doc)\
    .OfCategory(BuiltInCategory.OST_Rooms)\
    .WhereElementIsNotElementType()\
    .ToElements()
for r in host_rooms:
    if r.Area > 0:
        all_rooms.append((r, doc))

link_instances = FilteredElementCollector(doc)\
    .OfClass(RevitLinkInstance)\
    .ToElements()
for li in link_instances:
    link_doc = li.GetLinkDocument()
    if link_doc is None:
        continue
    for r in FilteredElementCollector(link_doc)\
            .OfCategory(BuiltInCategory.OST_Rooms)\
            .WhereElementIsNotElementType()\
            .ToElements():
        if r.Area > 0:
            all_rooms.append((r, link_doc))

# Imprime todos los parámetros disponibles del primer room
diagnostico = []
if all_rooms:
    room, _ = all_rooms[0]
    for p in room.Parameters:
        try:
            val = p.AsString() or p.AsValueString() or str(p.AsDouble())
        except:
            val = "(error)"
        diagnostico.append("{} = {}".format(p.Definition.Name, val))

OUT = diagnostico
# ----------------------------------------
n2_Create_Mass_And_WS = Python(IN[0]=n1_Control_Par)  # "2_Create_Mass_And_WS"; CPython3
# ---------- n2_Create_Mass_And_WS.python (155 lines) ----------
import clr
clr.AddReference('RevitAPI')
clr.AddReference('RevitServices')
from Autodesk.Revit.DB import *
from RevitServices.Persistence import DocumentManager
from RevitServices.Transactions import TransactionManager

doc = DocumentManager.Instance.CurrentDBDocument
WORKSET_NAME = "Rooms_3D_Visual"

# ══════════════════════════════════════════════════════════════
# PARAM_MAP — nombres confirmados por el nodo de diagnóstico
# ══════════════════════════════════════════════════════════════
PARAM_MAP = [
    # Parámetros nativos leídos por nombre — más fiable en vinculados
    ("Room_Name",       "Name"),
    ("Room_Number",     "Number"),
    ("Room_Level",      "Level"),
    ("Room_Department", "Department"),
    ("Room_Area_m2",    "Area"),          # se convierte a m² aparte
    # Parámetros de proyecto
    ("VivNumero",       "DAT_TXT_VivNumero"),
    ("VivPlanta",       "DAT_TXT_VivPlanta"),
    ("VivTipo",         "DAT_TXT_VivTipo"),
    ("Bloque",          "DAT_TXT_VivBloque"),
    ("Categoria",       "AHM_CNT_00_Categoria"),
    ("AcabadoSuelo",    "AHM_MAT_AcabadodelSuelo"),
    ("AcabadoMuro",     "AHM_MAT_AcabadodelMuro"),
]
# ══════════════════════════════════════════════════════════════

# ── 1. Workset ─────────────────────────────────────────────
workset_id = None
for ws in FilteredWorksetCollector(doc).OfKind(WorksetKind.UserWorkset):
    if ws.Name == WORKSET_NAME:
        workset_id = ws.Id
        break

if workset_id is None:
    TransactionManager.Instance.EnsureInTransaction(doc)
    new_ws = Workset.Create(doc, WORKSET_NAME)
    workset_id = new_ws.Id
    TransactionManager.Instance.TransactionTaskDone()

# ── 2. Recoger rooms ───────────────────────────────────────
all_rooms = []

for r in FilteredElementCollector(doc)\
        .OfCategory(BuiltInCategory.OST_Rooms)\
        .WhereElementIsNotElementType().ToElements():
    if r.Area > 0:
        all_rooms.append((r, doc, None))

for li in FilteredElementCollector(doc)\
        .OfClass(RevitLinkInstance).ToElements():
    link_doc = li.GetLinkDocument()
    if link_doc is None:
        continue
    transform = li.GetTotalTransform()
    for r in FilteredElementCollector(link_doc)\
            .OfCategory(BuiltInCategory.OST_Rooms)\
            .WhereElementIsNotElementType().ToElements():
        if r.Area > 0:
            all_rooms.append((r, link_doc, transform))

# ── 3. Helpers ─────────────────────────────────────────────
def is_valid_solid(geo):
    try:
        if geo is None or not isinstance(geo, Solid):
            return False
        if geo.Volume <= 1e-6 or geo.Faces.Size == 0:
            return False
        return True
    except:
        return False

def get_room_value(room, param_def):
    try:
        p = room.LookupParameter(param_def)

        if p is None:
            return ""

        # Área: convertir de ft² a m²
        if param_def == "Area":
            raw = p.AsDouble()
            if raw > 0:
                return "{:.2f}".format(raw * 0.092903)
            return ""

        # Intentar AsString primero
        val = p.AsString()
        if val and val.strip() and val != "0.0":
            return val.strip()

        # Si no, AsValueString (para parámetros numéricos o de tipo)
        val = p.AsValueString()
        if val and val.strip() and val != "0.0":
            return val.strip()

        return ""
    except:
        return ""

# ── 4. Crear masas ─────────────────────────────────────────
cat_id  = ElementId(BuiltInCategory.OST_Mass)
created = []
errors  = []

TransactionManager.Instance.EnsureInTransaction(doc)

for room, source_doc, transform in all_rooms:
    room_name = room.get_Parameter(BuiltInParameter.ROOM_NAME).AsString() or "?"
    try:
        calc   = SpatialElementGeometryCalculator(source_doc)
        result = calc.CalculateSpatialElementGeometry(room)
        geo    = result.GetGeometry()

        if transform is not None and not transform.IsIdentity:
            geo = SolidUtils.CreateTransformed(geo, transform)

        if not is_valid_solid(geo):
            errors.append("{}: geometría no válida, omitida".format(room_name))
            continue

        ds = DirectShape.CreateElement(doc, cat_id)
        ds.SetShape([geo])

        room_num = room.get_Parameter(BuiltInParameter.ROOM_NUMBER).AsString() or ""
        ds.Name  = "{} {}".format(room_name, room_num).strip()

        comment_parts = []
        for label, param_def in PARAM_MAP:
            val = get_room_value(room, param_def)
            comment_parts.append("{}: {}".format(label, val))

        p_comments = ds.get_Parameter(BuiltInParameter.ALL_MODEL_INSTANCE_COMMENTS)
        if p_comments:
            p_comments.Set(" | ".join(comment_parts))

        ws_param = ds.get_Parameter(BuiltInParameter.ELEM_PARTITION_PARAM)
        if ws_param and not ws_param.IsReadOnly:
            ws_param.Set(workset_id.IntegerValue)

        created.append(ds.Name)

    except Exception as e:
        errors.append("{}: {}".format(room_name, str(e)))

TransactionManager.Instance.TransactionTaskDone()

OUT = [
    "✓ {} masas creadas en workset '{}'".format(len(created), WORKSET_NAME),
    errors if errors else "Sin errores"
]
# ----------------------------------------
n3_color_mass = Python(IN[0]=n2_Create_Mass_And_WS)  # "3. Color_Mass"; CPython3
# ---------- n3_color_mass.python (150 lines) ----------
import clr
clr.AddReference('RevitAPI')
clr.AddReference('RevitServices')
from Autodesk.Revit.DB import *
from RevitServices.Persistence import DocumentManager
from RevitServices.Transactions import TransactionManager

doc = DocumentManager.Instance.CurrentDBDocument

# ══════════════════════════════════════════════════════════════
# REGLAS DE COLOR
# Formato: ("label del PARAM_MAP", "modo", "valor", (R, G, B))
# Modos: "equals" | "contains" | "startswith" | "endswith"
# Comparación ignora mayúsculas/minúsculas
# ══════════════════════════════════════════════════════════════
COLOR_RULES = [
    # Por Tipo de Recinto
    # ("Room_Name", "contains", "SALÓN", (80, 180, 255)),   # azul
    # ("Room_Name", "contains", "DORMITORIO 2", (255, 180,  80)),   # naranja
    # ("Room_Name", "contains", "DORMITORIO 3", (120, 220, 120)),   # verde
      ("Room_Name", "contains", "Büro", (255, 100, 100)),   # rojo
      ("Room_Name", "contains", "Bad", (120, 220, 120)),
      ("Room_Name", "contains", "Balkon", (80, 180, 255)),
    
    # Por bloque — usando "contains" porque el nivel incluye prefijo numérico
    # ("Room_Level", "contains", "BL01", (255, 100, 100)),   # rojo
    # ("Room_Level", "contains", "BL2", (255, 180,  80)),   # naranja
    # ("Room_Level", "contains", "BL03", ( 80, 180, 255)),   # azul
    # ("Room_Level", "contains", "BL04", (120, 220, 120)),   # verde

    # Zonas especiales
    # ("Room_Level", "contains", "GARAJE",    (160, 160, 160)),  # gris
    # ("Room_Level", "contains", "DEPURADORA",(100, 200, 200)),  # cyan
    # ("Room_Level", "contains", "PISCINA",   ( 80, 140, 255)),  # azul agua
    # ("Room_Level", "contains", "LÁMINA",    ( 80, 140, 255)),  # azul agua

    # Por planta si lo necesitas
    # ("VivPlanta", "equals", "P00", (200, 255, 200)),
    # ("VivPlanta", "equals", "S01", (200, 200, 255)),

    # Por tipo de vivienda
    # ("VivTipo", "equals", "TR", (220, 200, 100)),
]
DEFAULT_COLOR = (220, 220, 220)  # gris para rooms sin regla — None para no aplicar
TRANSPARENCY  = 30               # 0 = opaco, 100 = invisible
# ══════════════════════════════════════════════════════════════

# ── Vista 3D activa ────────────────────────────────────────
active_view = doc.ActiveView
if not isinstance(active_view, View3D):
    OUT = ["ERROR: la vista activa no es una vista 3D."]
    raise Exception("Vista activa no es 3D")

# ── Recoger masas del workset Rooms_3D_Visual ──────────────
WORKSET_NAME = "Rooms_3D_Visual"
workset_id = None
for ws in FilteredWorksetCollector(doc).OfKind(WorksetKind.UserWorkset):
    if ws.Name == WORKSET_NAME:
        workset_id = ws.Id
        break

if workset_id is None:
    OUT = ["ERROR: workset '{}' no encontrado.".format(WORKSET_NAME)]
    raise Exception("Workset no encontrado")

masses = [
    m for m in FilteredElementCollector(doc)
        .OfCategory(BuiltInCategory.OST_Mass)
        .WhereElementIsNotElementType()
        .ToElements()
    if m.get_Parameter(BuiltInParameter.ELEM_PARTITION_PARAM) is not None
    and m.get_Parameter(BuiltInParameter.ELEM_PARTITION_PARAM)
        .AsInteger() == workset_id.IntegerValue
]

# ── Leer valor de Comments por label ──────────────────────
def get_comment_value(mass, label):
    p = mass.get_Parameter(BuiltInParameter.ALL_MODEL_INSTANCE_COMMENTS)
    if p is None:
        return None
    for part in (p.AsString() or "").split(" | "):
        if part.startswith(label + ":"):
            val = part.split(":", 1)[1].strip()
            return val if val and val != "0.0" else None
    return None

# ── Evaluar modo de comparación ────────────────────────────
def rule_matches(comment_val, mode, rule_value):
    a = comment_val.lower()
    b = rule_value.lower()
    if mode == "equals":
        return a == b
    elif mode == "contains":
        return b in a
    elif mode == "startswith":
        return a.startswith(b)
    elif mode == "endswith":
        return a.endswith(b)
    return False

# ── Buscar patrón sólido una sola vez ─────────────────────
solid_pattern_id = None
for fp in FilteredElementCollector(doc).OfClass(FillPatternElement):
    if fp.GetFillPattern().IsSolidFill:
        solid_pattern_id = fp.Id
        break

# ── Crear OverrideGraphicSettings ─────────────────────────
def make_override(r, g, b):
    ogs = OverrideGraphicSettings()
    color = Color(r, g, b)
    ogs.SetSurfaceForegroundPatternColor(color)
    ogs.SetSurfaceForegroundPatternVisible(True)
    if solid_pattern_id:
        ogs.SetSurfaceForegroundPatternId(solid_pattern_id)
    ogs.SetSurfaceTransparency(TRANSPARENCY)
    ogs.SetProjectionLineColor(color)
    return ogs

# ── Aplicar overrides ──────────────────────────────────────
colored   = 0
defaulted = 0
no_match_names = []

TransactionManager.Instance.EnsureInTransaction(doc)

for mass in masses:
    matched_color = None

    for label, mode, value, rgb in COLOR_RULES:
        comment_val = get_comment_value(mass, label)
        if comment_val and rule_matches(comment_val, mode, value):
            matched_color = rgb
            break

    if matched_color:
        active_view.SetElementOverrides(mass.Id, make_override(*matched_color))
        colored += 1
    elif DEFAULT_COLOR:
        active_view.SetElementOverrides(mass.Id, make_override(*DEFAULT_COLOR))
        defaulted += 1
        no_match_names.append(mass.Name)

TransactionManager.Instance.TransactionTaskDone()

OUT = [
    "✓ {} masas coloreadas por regla".format(colored),
    "○ {} masas con color por defecto".format(defaulted),
    "Sin regla: {}".format(no_match_names[:20]) if no_match_names else "Todas con regla"
]
# ----------------------------------------
watch = Watch(n3_color_mass)
watch_2 = Watch(n1_Control_Par)
n1_Inspect = Python(IN[0]=n2_Create_Mass_And_WS)  # "2.1_Inspect"; CPython3
# ---------- n1_Inspect.python (48 lines) ----------
import clr
clr.AddReference('RevitAPI')
clr.AddReference('RevitServices')
from Autodesk.Revit.DB import *
from RevitServices.Persistence import DocumentManager

doc = DocumentManager.Instance.CurrentDBDocument

WORKSET_NAME = "Rooms_3D_Visual"
workset_id = None
for ws in FilteredWorksetCollector(doc).OfKind(WorksetKind.UserWorkset):
    if ws.Name == WORKSET_NAME:
        workset_id = ws.Id
        break

masses = [
    m for m in FilteredElementCollector(doc)
        .OfCategory(BuiltInCategory.OST_Mass)
        .WhereElementIsNotElementType()
        .ToElements()
    if m.get_Parameter(BuiltInParameter.ELEM_PARTITION_PARAM) is not None
    and m.get_Parameter(BuiltInParameter.ELEM_PARTITION_PARAM)
        .AsInteger() == workset_id.IntegerValue
]

# Extraer valores únicos de Room_Level y VivPlanta
levels   = set()
plantas  = set()
tipos    = set()

for mass in masses:
    p = mass.get_Parameter(BuiltInParameter.ALL_MODEL_INSTANCE_COMMENTS)
    if p is None:
        continue
    comments = p.AsString() or ""
    for part in comments.split(" | "):
        if part.startswith("Room_Level:"):
            levels.add(part.split(":",1)[1].strip())
        elif part.startswith("VivPlanta:"):
            plantas.add(part.split(":",1)[1].strip())
        elif part.startswith("VivTipo:"):
            tipos.add(part.split(":",1)[1].strip())

OUT = [
    "Room_Level únicos: {}".format(sorted(levels)),
    "VivPlanta únicos: {}".format(sorted(plantas)),
    "VivTipo únicos: {}".format(sorted(tipos)),
]
# ----------------------------------------
watch_3 = Watch(n1_Inspect)
watch_4 = Watch(n1_Clean_Mass)
