# Dynamo graph URB01_ProjectData.dyn (Dynamo 2.19.3.6394)

# group: Input file to list
file_path = Filename(".\URB01_ProjectData.csv")
boolean = BoolSelector(true)
importCSV = Data.ImportCSV(filePath=file_path, transpose=boolean)
restOfItems = List.RestOfItems(list=importCSV)
transpose = List.Transpose(lists=restOfItems)
code_block = CodeBlock { 0; 1; 2; 3; 4; 5; 6; 7; 8; 9; 10; 11; }

# group: List from csv
getItemAtIndex = List.GetItemAtIndex(list=transpose, index=code_block.out0)
getItemAtIndex_2 = List.GetItemAtIndex(list=transpose, index=code_block.out1)
getItemAtIndex_3 = List.GetItemAtIndex(list=transpose, index=code_block.out2)
getItemAtIndex_4 = List.GetItemAtIndex(list=transpose, index=code_block.out3)
getItemAtIndex_5 = List.GetItemAtIndex(list=transpose, index=code_block.out4)
getItemAtIndex_6 = List.GetItemAtIndex(list=transpose, index=code_block.out5)
getItemAtIndex_7 = List.GetItemAtIndex(list=transpose, index=code_block.out6)
getItemAtIndex_8 = List.GetItemAtIndex(list=transpose, index=code_block.out7)
getItemAtIndex_9 = List.GetItemAtIndex(list=transpose, index=code_block.out8)
getItemAtIndex_10 = List.GetItemAtIndex(list=transpose, index=code_block.out9)
getItemAtIndex_11 = List.GetItemAtIndex(list=transpose, index=code_block.out10)
getItemAtIndex_12 = List.GetItemAtIndex(list=transpose, index=code_block.out11)
list_create = List.Create(item0=getItemAtIndex, item1=getItemAtIndex_2, item2=getItemAtIndex_3, item3=getItemAtIndex_4, item4=getItemAtIndex_5, item5=getItemAtIndex_6, item6=getItemAtIndex_7, item7=getItemAtIndex_8, item8=getItemAtIndex_9, item9=getItemAtIndex_10, item10=getItemAtIndex_11, item11=getItemAtIndex_12)

# group: Output Process
python_script = Python()  # CPython3; unwired: IN[0]
# ---------- python_script.python (37 lines) ----------
import clr
clr.AddReference('RevitAPI')
clr.AddReference('RevitAPIUI')
from Autodesk.Revit.DB import *

import RevitServices
from RevitServices.Persistence import DocumentManager

app = DocumentManager.Instance.CurrentUIApplication.Application

# Orden esperado según el CSV
orden = [
    "URB01-ARQ-00-00-M3-UR-AP-0001",
    "URB01-ARQ-E01-00-M3-AR-AP-0001",
    "URB01-ARQ-E02-00-M3-AR-AP-0001",
    "URB01-ARQ-E03-00-M3-AR-AP-0001",
    "URB01-ARQ-E04-00-M3-AR-AP-0001",
    "URB01-ARQ-E05-00-M3-AR-AP-0001",
    "URB01-ARQ-E06-00-M3-AR-AP-0001",
    "URB01-ARQ-E07-00-M3-AR-AP-0001",
]

docs_raw = []
for doc in app.Documents:
    if not doc.IsFamilyDocument and not doc.IsLinked:
        if "URB01" in doc.Title:
            docs_raw.append(doc)

# Ordenar según el CSV
docs_ordenados = []
for nombre in orden:
    for doc in docs_raw:
        if nombre in doc.Title:
            docs_ordenados.append(doc)
            break

OUT = docs_ordenados
# ----------------------------------------
python_script_2 = Python(IN[0]=python_script, IN[1]=list_create)  # CPython3
# ---------- python_script_2.python (54 lines) ----------
import clr
clr.AddReference('RevitAPI')
from Autodesk.Revit.DB import *

import RevitServices
from RevitServices.Persistence import DocumentManager
from RevitServices.Transactions import TransactionManager

docs        = IN[0]
all_values  = IN[1]  # sin [0] — la estructura ya es correcta

param_names = [
    "Project Name",
    "Project Number",
    "Building Name",
    "Client Name",
    "Project Address",
    "Organization Name",
    "INF_proyecto_nombre",
    "INF_promotor_nombre",
    "INF_promotor_direccion",
    "INF_proyecto_descripcion",
    "SiteName",
]

active_doc = DocumentManager.Instance.CurrentDBDocument
results = []

for i, doc in enumerate(docs):
    try:
        if doc.Title == active_doc.Title:
            TransactionManager.Instance.EnsureInTransaction(doc)
            pi = doc.ProjectInformation
            for j, pname in enumerate(param_names):
                p = pi.LookupParameter(pname)
                if p and not p.IsReadOnly:
                    p.Set(str(all_values[j+1][i]))
            TransactionManager.Instance.TransactionTaskDone()
        else:
            t = Transaction(doc, "ISO19650: Project Info")
            t.Start()
            pi = doc.ProjectInformation
            for j, pname in enumerate(param_names):
                p = pi.LookupParameter(pname)
                if p and not p.IsReadOnly:
                    p.Set(str(all_values[j+1][i]))
            t.Commit()

        results.append("OK: " + doc.Title)

    except Exception as e:
        results.append("ERROR: " + doc.Title + " — " + str(e))

OUT = results
# ----------------------------------------
watch = Watch(python_script_2)
